# Dynamo graph 04_TABLAS y Listados.dyn (Dynamo 4.0.2.3852)
# Estampa la TABLA N.1 de tipos de riel RUC en cada lamina de sector, con las filas de los tipos que se ven en esa lamina.

n01_procesar_todos_los_sectores = BoolSelector(false)  # "01. Procesar TODOS los sectores"; graph input
n02_filtro_de_sectores_si_todos = StringInput("SECTOR A")  # "02. Filtro de sectores (si TODOS = False)"; graph input
n03_la_familia_del_riel_empieza = StringInput("RIEL RUC")  # "03. La familia del riel EMPIEZA con"; graph input
n04_parametro_de_donde_se_lee_el = StringInput("Longitud")  # "04. Parametro de donde se LEE el largo del riel"; graph input
n05_parametro_numerico_donde_se = StringInput("LARGO_TBL")  # "05. Parametro numerico donde se COPIA el largo (se crea si no existe)"; graph input
n06_parametro_donde_se_escribe_el = StringInput("TEXTO PARA TAG")  # "06. Parametro donde se escribe el codigo de tipo"; graph input
n07_parametro_donde_se_marca_en = StringInput("En plano")  # "07. Parametro donde se marca en que lamina aparece"; graph input
n08_parametro_donde_se_escribe_el = StringInput("ITEM")  # "08. Parametro donde se escribe el ITEM (vacio = sin columna)"; graph input
n09_titulo_de_la_tabla = StringInput("TABLA N°1 (NOTA 9)")  # "09. Titulo de la tabla"; graph input
n10_margen_de_la_lamina_mm_el = IntegerSlider(5, range=0..60 step 1)  # "10. Margen de la lamina (mm) - el mismo que 01 y 02"; graph input
n11_franja_inferior_reservada_de = IntegerSlider(55, range=0..200 step 1)  # "11. Franja inferior reservada de la vineta (mm)"; graph input
n12_ancho_del_cajetin_desde_el = IntegerSlider(290, range=0..600 step 1)  # "12. Ancho del cajetin desde el borde derecho (mm)"; graph input
n13_alto_del_cajetin_mm = IntegerSlider(105, range=0..400 step 1)  # "13. Alto del cajetin (mm)"; graph input
n14_esquina_desde_donde_buscar = StringInput("abajo-derecha")  # "14. Esquina desde donde buscar hueco"; graph input
n15_rehacer_las_tablas_existentes = BoolSelector(false)  # "15. Rehacer las tablas existentes"; graph input
py_tabla_de_tipos_de_riel_por = Python(IN[0]=n01_procesar_todos_los_sectores, IN[1]=n02_filtro_de_sectores_si_todos, IN[2]=n03_la_familia_del_riel_empieza, IN[3]=n04_parametro_de_donde_se_lee_el, IN[4]=n05_parametro_numerico_donde_se, IN[5]=n06_parametro_donde_se_escribe_el, IN[6]=n07_parametro_donde_se_marca_en, IN[7]=n08_parametro_donde_se_escribe_el, IN[8]=n09_titulo_de_la_tabla, IN[9]=n10_margen_de_la_lamina_mm_el, IN[10]=n11_franja_inferior_reservada_de, IN[11]=n12_ancho_del_cajetin_desde_el, IN[12]=n13_alto_del_cajetin_mm, IN[13]=n14_esquina_desde_donde_buscar, IN[14]=n15_rehacer_las_tablas_existentes)  # "PY | Tabla de tipos de riel por lamina"; PythonNet3
# ---------- py_tabla_de_tipos_de_riel_por.python (868 lines) ----------
# 04_TABLAS y Listados - ILUMINACION
#
# Estampa la TABLA N.1 -la tabla de tipos de RIEL RUC- en las laminas de sector, una por
# lamina, con las filas de los tipos que aparecen EN ESA LAMINA.
#
#   +-------------------------------------+
#   |        TABLA N.1 (NOTA 9)           |
#   +--------+----------+-----------------+
#   |  ITEM  |   TIPO   |   LARGO (mm)    |
#   +--------+----------+-----------------+
#   |    1   |   R-01   |       100       |
#   |    3   |   R-03   |       300       |
#   |    4   |   R-04   |       400       |
#   +--------+----------+-----------------+
#
# Revit 2027 / Dynamo 4 / CPython3
# IN[0]  = procesar todos los sectores (bool)
# IN[1]  = filtro de sectores si IN[0] es False (parcial, comas)
# IN[2]  = la familia del riel EMPIEZA con (string, ej. RIEL RUC)
# IN[3]  = parametro de donde se LEE el largo del riel (string, ej. Longitud)
# IN[4]  = parametro numerico donde se COPIA el largo para que el schedule pueda usarlo
#          (string, ej. LARGO_TBL); se crea como parametro de proyecto si no existe
# IN[5]  = parametro donde se escribe el codigo de tipo (string, ej. TEXTO PARA TAG)
# IN[6]  = parametro donde se marca en que lamina aparece (string, ej. En plano)
# IN[7]  = parametro donde se escribe el ITEM (string; vacio = tabla sin columna ITEM)
# IN[8]  = titulo de la tabla (string)
# IN[9]  = margen de la lamina, en mm - el mismo que usan 01 y 02
# IN[10] = alto de la franja inferior reservada de la vineta, en mm
# IN[11] = ancho del cajetin medido desde el borde derecho, en mm
# IN[12] = alto del cajetin medido desde el borde inferior, en mm
# IN[13] = esquina por la que se empieza a buscar hueco (abajo-derecha, abajo-izquierda,
#          arriba-derecha, arriba-izquierda)
# IN[14] = rehacer: reconfigura las tablas existentes y las vuelve a colocar
#
#
# QUE HACE HOY Y QUE NO
#
# Solo la tabla de rieles. El paso se llama "TABLAS y Listados" en plural porque va a
# juntar mas -listado de circuitos, de luminarias, notas-, pero cada una se agrega cuando
# este definida, no antes. Este archivo reemplaza por completo a "04_Tabla de materiales",
# que era la tabla de acero heredada de T003 y no tenia nada que ver con iluminacion: no se
# adapto, se tiro. Esta en el historial de git si alguna vez hace falta mirarla.
#
#
# QUE LAMINAS TOCA
#
# Las que tienen vistas del pipeline, reconocidas por el MISMO contrato de nombres que
# comparten 00, 01, 02 y 03: "<sector> - PLANTA" y "<sector> - ELEV X". No hay parametro
# sello ni lista de laminas que mantener: si una lamina tiene una vista de sector, es del
# pipeline. Vale ademas la regla de aislamiento que fija 01 -cada lamina lleva vistas de UN
# SOLO sector-, asi que "el sector de esta lamina" nunca es ambiguo.
#
#
# QUE FILAS LLEVA CADA TABLA, Y POR QUE NO ES LA MISMA EN TODAS LAS LAMINAS
#
# Las de los tipos que se ven en LAS VISTAS DE ESA LAMINA, no las del sector entero. Un
# sector puede ocupar varias laminas, y una tabla que liste tipos que no estan dibujados en
# la hoja que uno tiene delante obliga a buscarlos en otra hoja: es informacion equivocada,
# no informacion de mas.
#
# "Se ve en la lamina" es la union de lo que se ve en cada viewport: la planta y las cuatro
# elevaciones. No solo la planta, porque cuando un sector se derrama a una segunda lamina
# esa lamina puede llevar solo elevaciones, y su tabla tiene que decir algo igual.
#
#
# EL CODIGO R-xx: MISMA REGLA QUE 03, Y POR QUE SE VUELVE A CALCULAR ACA
#
# Los largos de TODOS los rieles RUC del modelo, ordenados de menor a mayor, numerados
# R-01, R-02, R-03... El codigo es global al modelo -R-02 significa lo mismo en todas las
# laminas- y sale del parametro de instancia de IN[3], redondeado al milimetro entero.
# Es, letra por letra, la regla de 03_Taggear plantas y cortes: tiene que serlo, porque el
# texto que 03 dibuja en la planta y la fila que esta tabla imprime son el mismo dato.
#
# Se recalcula aca en vez de leerse de lo que dejo 03 para que este paso funcione solo -se
# puede correr sin haber corrido 03, y no depende de en que orden se corrieron-. El precio
# es que la regla vive escrita en dos graphs: si se cambia en uno hay que cambiarla en el
# otro, y el sintoma seria un plano que dice R-05 con una tabla que dice R-06. Es la deuda
# conocida de este paso; la forma de saldarla es que 03 vuelva a escribir el parametro y
# que aca solo se lea.
#
#
# POR QUE HAY DOS PARAMETROS DE LARGO
#
# Porque el largo de verdad no se puede poner en un schedule. "Longitud" es un parametro
# DE FAMILIA de las familias de riel -no es compartido ni de proyecto-, y Revit no ofrece
# los parametros de familia como campos de schedule: no aparecen en la lista y no hay API
# que los agregue. Se comprueba en un minuto y conviene saberlo antes de disenar nada:
# una MORDAZA, que es otra familia de la misma categoria, NO tiene "Longitud", mientras que
# "En plano" si aparece en la mordaza y hasta en las vistas, que es la firma de un
# parametro de PROYECTO.
#
# Asi que el largo se lee de "Longitud" (IN[3]) y se COPIA a un parametro numerico de
# proyecto (IN[4]) que si es schedulable, y la columna LARGO imprime esa copia. Si ese
# parametro no existe en el modelo, el graph lo crea -parametro compartido con un GUID
# derivado de su nombre, para que sea el mismo en todos los modelos de la oficina, y
# vinculado como parametro de instancia de Electrical Fixtures-. Es la misma maquinaria
# que usaba la tabla de acero de T003 por el mismo motivo.
#
# El valor copiado son MILIMETROS como numero pelado, no una longitud de Revit. Un
# parametro de tipo Number no convierte unidades, asi que 100 se guarda 100 y se imprime
# 100, sin depender de si el proyecto trabaja en metros o en pies.
#
# La copia es un dato derivado, y los datos derivados se desactualizan: si alguien cambia
# el largo de un riel, la columna miente hasta que se vuelva a correr este paso. No hay
# manera de evitarlo con un schedule nativo -esa es la parte del trato-.
#
#
# COMO SABE UN SCHEDULE QUE RIELES SON DE SU LAMINA
#
# No lo sabe: un schedule de Revit no puede filtrar por "esta dibujado en tal lamina". Hay
# que decirselo con un dato del modelo, y ese dato es el parametro de IN[5] -por defecto
# "En plano", que las familias de riel ya traen vacio-. El graph escribe ahi la lista de
# laminas donde el riel aparece, y el schedule de cada lamina filtra por "contiene".
#
# La lista va con punto y coma alrededor de cada numero -";A1;A2;"- y el filtro busca
# ";A1;" y no "A1". Sin los delimitadores, la lamina A1 se llevaria tambien los rieles de
# A11 y A12, que es el clasico error de filtrar numeros de lamina por substring.
#
# El campo del filtro se agrega OCULTO al schedule: hace falta que este entre los campos
# para poder filtrar por el, pero no tiene que salir impreso en la tabla.
#
#
# LO QUE HAY QUE MIRAR EN EL PRIMER RUN: SI LAS FILAS COLAPSAN
#
# La tabla tiene que mostrar una fila POR TIPO, no una por riel, y eso se consigue apagando
# "Itemize every instance". Revit colapsa las filas que tienen todos los campos iguales, y
# el campo oculto del filtro NO es igual entre rieles -uno puede estar en ";A1;" y otro en
# ";A1;A2;"-. Si Revit resultara considerar tambien los campos ocultos para colapsar, la
# tabla saldria con una fila por riel.
#
# En vez de afirmar que funciona, el graph se fija y lo dice: compara las filas que quedaron
# en el cuerpo del schedule contra la cantidad de tipos distintos que le corresponden a esa
# lamina, y si no coinciden lo avisa en el log con las dos cifras. Si aparece ese aviso, la
# salida es dejar de filtrar por parametro y dibujar la tabla con lineas y textos, que da
# control total a cambio de que no quede viva.
#
#
# LA COLUMNA ITEM ES EL NUMERO DEL CODIGO, NO UN CONTADOR DE FILA
#
# En el plano tipo la tabla va 1, 2, 3, 4 junto a R-01, R-02, R-03, R-04: ITEM es el
# correlativo de la fila y coincide con el codigo porque ahi estan todos los tipos. Cuando
# una lamina usa solo algunos, las dos cosas dejan de coincidir, y hay que elegir.
#
# Aca ITEM es el NUMERO DEL CODIGO: la lamina que usa R-01, R-03 y R-04 imprime 1, 3 y 4.
# No es capricho sino una consecuencia del mecanismo: un schedule de Revit no tiene campo
# "numero de fila", asi que el ITEM tiene que ser un parametro escrito en el riel, y un
# riel que aparece en dos laminas tendria que tener dos ITEM distintos al mismo tiempo si
# el numero fuera por tabla. Con el numero del codigo el dato es uno solo y no se
# contradice. Ademas se lee mejor de lo que parece: ITEM y TIPO dicen lo mismo, y el salto
# avisa que ese tipo no esta en esta hoja.
#
# Si IN[6] queda vacio, la tabla sale con dos columnas y sin ITEM.
#
#
# DONDE SE PARA LA TABLA
#
# En el hueco libre mas cercano a la esquina de IN[12]. Hace falta buscarlo porque 01 y 02
# reparten las vistas por el lienzo COMPLETO de la vineta: cuando se escribieron, este paso
# no existia, y el comentario de los dos dice "aca no hay tabla". Antes que reabrir esa
# decision y tocar tres graphs -mas laminas, otro empaquetado-, este paso se arregla solo
# con lo que sobra.
#
# Ocupado es: los viewports con su titulo, la franja inferior de la vineta (IN[9]) y el
# cajetin (IN[10] x IN[11]). Esos tres rectangulos no se pueden deducir de la geometria de
# la vineta -es una sola familia que ocupa toda la hoja- asi que son inputs, y son
# constantes del proyecto: se cargan una vez y no se tocan mas.
#
# El tamano de la tabla no se estima: se coloca, se le mide el bounding box real y recien
# ahi se la mueve al hueco. Estimar el alto de un schedule por la cantidad de filas y el
# tipo de letra es adivinar, y un error de dos milimetros la deja pisando una vista.
#
# Si no hay hueco, la tabla se coloca igual en la esquina pedida y el log avisa: una tabla
# encimada se ve y se corrige a mano, una tabla que no se coloco pasa desapercibida.

import clr
import math
import os
import hashlib
import tempfile
clr.AddReference('RevitAPI')
clr.AddReference('RevitServices')
from Autodesk.Revit.DB import (FilteredElementCollector, ViewSheet, ViewSchedule,
                               ScheduleSheetInstance, ScheduleFilter, ScheduleFilterType,
                               ScheduleSortGroupField, Viewport, View, XYZ, Element,
                               ElementId, BuiltInCategory, BuiltInParameter, StorageType,
                               FamilyInstance, FormatOptions, UnitTypeId, SectionType,
                               CategorySet, CategoryType, GroupTypeId, SpecTypeId,
                               ExternalDefinitionCreationOptions)
from RevitServices.Persistence import DocumentManager
from RevitServices.Transactions import TransactionManager
from System import Guid

doc = DocumentManager.Instance.CurrentDBDocument
app = doc.Application

process_all = bool(IN[0])
filter_text = (IN[1] or '').strip()
fam_prefijo = (IN[2] or '').strip()
param_largo = (IN[3] or 'Longitud').strip()
param_largo_tbl = (IN[4] or 'LARGO_TBL').strip()
param_codigo = (IN[5] or 'TEXTO PARA TAG').strip()
param_lamina = (IN[6] or 'En plano').strip()
param_item = (IN[7] or '').strip()
titulo_tabla = (IN[8] or 'TABLA N1').strip()
margen = float(IN[9]) / 304.8
franja_inferior = float(IN[10]) / 304.8
cajetin_ancho = float(IN[11]) / 304.8
cajetin_alto = float(IN[12]) / 304.8
esquina = (IN[13] or 'abajo-derecha').strip().lower()
rehacer = bool(IN[14])

log = []

# --- contrato de nombres con 00_Vistas de sector ---
SUF_PLANTA = ' - PLANTA'
SUF_ELEV = ' - ELEV '

PREFIJO_TIPO = 'R-'
PREFIJO_SCHEDULE = 'TBL_RIELES_'

H_ITEM = 'ITEM'
H_TIPO = 'TIPO'
H_LARGO = 'LARGO (mm)'

# Paso de la grilla con que se barre la lamina buscando hueco, en mm de papel. 5 mm es mas
# fino que cualquier ajuste que alguien haga despues a mano y deja el barrido en unos pocos
# miles de posiciones por lamina.
PASO_BUSQUEDA = 5.0 / 304.8


def elem_name(e):
    try:
        return Element.Name.GetValue(e)
    except Exception:
        try:
            return e.Name
        except Exception:
            return ''


def coincide(nombre, texto):
    # filtro parcial separado por comas, insensible a mayusculas. Mismo criterio que usan
    # 00, 01, 02 y 03 para elegir sectores.
    if not texto:
        return True
    alto = (nombre or '').upper()
    for t in texto.split(','):
        t = t.strip().upper()
        if t and t in alto:
            return True
    return False


def fam_name(el):
    try:
        return el.Symbol.Family.Name or ''
    except Exception:
        return ''


def es_riel(el):
    f = fam_name(el).upper()
    if not f:
        return False
    return not fam_prefijo or f.startswith(fam_prefijo.upper())


def largo_mm(el):
    # El largo sale del parametro de INSTANCIA y de ningun otro lado, redondeado al
    # milimetro. Mismo criterio que 03: el nombre de tipo miente -hay un "150 mm" que mide
    # 600- y ademas no es consistente entre familias.
    try:
        p = el.LookupParameter(param_largo)
    except Exception:
        return None
    if p is None or not p.HasValue or p.StorageType != StorageType.Double:
        return None
    mm = int(round(p.AsDouble() * 304.8))
    return mm if mm > 0 else None


def rieles_del_modelo():
    return [el for el in FilteredElementCollector(doc)
            .OfCategory(BuiltInCategory.OST_ElectricalFixtures)
            .WhereElementIsNotElementType()
            if isinstance(el, FamilyInstance) and es_riel(el)]


def tabla_de_tipos(rieles):
    largos = sorted(set(l for l in (largo_mm(e) for e in rieles) if l is not None))
    return dict((l, i + 1) for i, l in enumerate(largos))


def codigo_de(numero):
    return '{}{:02d}'.format(PREFIJO_TIPO, numero)


def sector_de_vista(v):
    n = elem_name(v)
    if n.endswith(SUF_PLANTA):
        return n[:-len(SUF_PLANTA)]
    i = n.find(SUF_ELEV)
    if i > 0:
        return n[:i]
    return None


def laminas_de_sector():
    # Lamina -> (sector, [vistas]). Una lamina es del pipeline si tiene alguna vista que
    # cumple el contrato de nombres; por la regla de aislamiento de 01, todas sus vistas de
    # sector son del mismo sector.
    res = []
    for sh in FilteredElementCollector(doc).OfClass(ViewSheet):
        if sh.IsTemplate:
            continue
        vistas = []
        sectores = set()
        for vp in FilteredElementCollector(doc, sh.Id).OfClass(Viewport):
            v = doc.GetElement(vp.ViewId)
            if v is None:
                continue
            s = sector_de_vista(v)
            if s is None:
                continue
            vistas.append(v)
            sectores.add(s)
        if not vistas:
            continue
        sector = sorted(sectores)[0]
        if len(sectores) > 1:
            log.append('AVISO: la lamina {} tiene vistas de mas de un sector ({}). La tabla '
                       'igual lista lo que se ve en la lamina, pero eso rompe la regla de '
                       'aislamiento que fija 01.'.format(sh.SheetNumber,
                                                         ', '.join(sorted(sectores))))
        if not process_all and not coincide(sector, filter_text):
            continue
        res.append((sh, sector, vistas))
    res.sort(key=lambda t: t[0].SheetNumber)
    return res


def rieles_de_lamina(vistas):
    # Union de los rieles visibles en cada viewport de la lamina. Se recolecta CONTRA LA
    # VISTA, asi que el crop, el view range y lo oculto ya deciden que se ve y que no, sin
    # volver a describir la caja del sector.
    vistos = {}
    for v in vistas:
        for el in (FilteredElementCollector(doc, v.Id)
                   .OfCategory(BuiltInCategory.OST_ElectricalFixtures)
                   .WhereElementIsNotElementType()):
            if isinstance(el, FamilyInstance) and es_riel(el):
                vistos[el.Id.Value] = el
    return list(vistos.values())


def guid_para(nombre):
    # GUID derivado del nombre: el parametro creado es el MISMO en todos los modelos de la
    # oficina sin depender de un archivo de parametros compartidos versionado.
    h = hashlib.md5(('ELE01_TBL::' + nombre.upper()).encode('utf-8')).hexdigest()
    return Guid(h)


def existe_como_campo(nombre):
    # La prueba de fuego no es que el parametro exista en el elemento, sino que Revit lo
    # ofrezca como CAMPO DE SCHEDULE. Un parametro de familia existe en el riel y no sirve.
    try:
        probe = ViewSchedule.CreateSchedule(doc, ElementId(BuiltInCategory.OST_ElectricalFixtures))
    except Exception:
        return False
    try:
        for f in probe.Definition.GetSchedulableFields():
            try:
                if f.GetName(doc) == nombre:
                    return True
            except Exception:
                continue
        return False
    finally:
        try:
            doc.Delete(probe.Id)
        except Exception:
            pass


def asegurar_param_numerico(nombre):
    # Crea el parametro como COMPARTIDO y lo vincula como parametro de proyecto de instancia
    # de Electrical Fixtures. Compartido y no de proyecto a secas porque asi ademas se puede
    # etiquetar y exportar, y porque el GUID derivado del nombre lo hace reproducible.
    if existe_como_campo(nombre):
        return True
    ruta = os.path.join(tempfile.gettempdir(), 'ELE01_params_tabla.txt')
    if not os.path.exists(ruta):
        # el archivo de parametros compartidos es un TSV con esta cabecera exacta; Revit no
        # lo crea solo y sin el OpenSharedParameterFile devuelve None
        tab = '\t'
        cab = ['# This is a Revit shared parameter file.',
               '*META' + tab + 'VERSION' + tab + 'MINVERSION',
               'META' + tab + '2' + tab + '1',
               '*GROUP' + tab + 'ID' + tab + 'NAME',
               '*PARAM' + tab + tab.join(['GUID', 'NAME', 'DATATYPE', 'DATACATEGORY',
                                          'GROUP', 'VISIBLE', 'DESCRIPTION',
                                          'USERMODIFIABLE', 'HIDEWHENNOVALUE'])]
        with open(ruta, 'w') as f:
            f.write('\n'.join(cab) + '\n')
    anterior = None
    try:
        anterior = app.SharedParametersFilename
    except Exception:
        pass
    try:
        app.SharedParametersFilename = ruta
        df = app.OpenSharedParameterFile()
        if df is None:
            log.append('ERROR: no se pudo abrir el archivo temporal de parametros compartidos.')
            return False
        grupo = None
        for g in df.Groups:
            if g.Name == 'TABLA_ILUMINACION':
                grupo = g
                break
        if grupo is None:
            grupo = df.Groups.Create('TABLA_ILUMINACION')
        defn = None
        for d in grupo.Definitions:
            if d.Name == nombre:
                defn = d
                break
        if defn is None:
            opts = ExternalDefinitionCreationOptions(nombre, SpecTypeId.Number)
            opts.GUID = guid_para(nombre)
            opts.Visible = True
            defn = grupo.Definitions.Create(opts)
        cats = CategorySet()
        cats.Insert(doc.Settings.Categories.get_Item(BuiltInCategory.OST_ElectricalFixtures))
        binding = app.Create.NewInstanceBinding(cats)
        ok = False
        try:
            ok = doc.ParameterBindings.Insert(defn, binding, GroupTypeId.Data)
        except Exception:
            try:
                ok = doc.ParameterBindings.Insert(defn, binding)
            except Exception:
                ok = False
        if not ok:
            try:
                ok = doc.ParameterBindings.ReInsert(defn, binding)
            except Exception:
                ok = False
        if ok:
            log.append('Se creo el parametro de proyecto "{}" (Number, instancia, Electrical '
                       'Fixtures) para la columna LARGO.'.format(nombre))
        else:
            log.append('ERROR: no se pudo crear ni vincular el parametro "{}"; la tabla se '
                       'va a quedar sin la columna del largo.'.format(nombre))
        return ok
    except Exception as e:
        log.append('ERROR creando el parametro "{}": {}'.format(nombre, e))
        return False
    finally:
        try:
            if anterior is not None:
                app.SharedParametersFilename = anterior
        except Exception:
            pass


def set_double(el, nombre, valor):
    if not nombre:
        return None
    try:
        p = el.LookupParameter(nombre)
    except Exception:
        return None
    if p is None or p.IsReadOnly or p.StorageType != StorageType.Double:
        return False
    try:
        if abs((p.AsDouble() or 0.0) - valor) > 1e-9:
            p.Set(valor)
        return True
    except Exception:
        return False


def set_string(el, nombre, valor):
    if not nombre:
        return None
    try:
        p = el.LookupParameter(nombre)
    except Exception:
        return None
    if p is None or p.IsReadOnly or p.StorageType != StorageType.String:
        return False
    try:
        if (p.AsString() or '') != valor:
            p.Set(valor)
        return True
    except Exception:
        return False


def marcar_rieles(mapa, laminas):
    # Escribe en cada riel del modelo su codigo, su ITEM y la lista de laminas donde
    # aparece. Se escribe sobre TODOS los rieles y no solo sobre los de las laminas
    # procesadas: el que ya no aparece en ninguna tiene que quedar con la marca VACIA, o su
    # tabla vieja lo seguiria contando.
    donde = {}
    for sh, sector, vistas in laminas:
        for el in rieles_de_lamina(vistas):
            donde.setdefault(el.Id.Value, []).append(sh.SheetNumber)

    escritos = 0
    sin_largo = 0
    sin_param = set()
    for el in rieles_del_modelo():
        l = largo_mm(el)
        if l is None or l not in mapa:
            sin_largo += 1
            continue
        numero = mapa[l]
        hojas = sorted(set(donde.get(el.Id.Value, [])))
        marca = ';{};'.format(';'.join(hojas)) if hojas else ''
        for nombre, valor in ((param_codigo, codigo_de(numero)),
                              (param_item, str(numero)),
                              (param_lamina, marca)):
            r = set_string(el, nombre, valor)
            if r is False:
                sin_param.add(nombre)
        if set_double(el, param_largo_tbl, float(l)) is False:
            sin_param.add(param_largo_tbl)
        escritos += 1
    log.append('Marcados {} riel(es) del modelo: codigo en "{}", lamina en "{}"{}.'.format(
        escritos, param_codigo, param_lamina,
        ', ITEM en "{}"'.format(param_item) if param_item else ''))
    if sin_largo:
        log.append('AVISO: {} riel(es) sin "{}" inicializado; no entran en ninguna '
                   'tabla.'.format(sin_largo, param_largo))
    for nombre in sorted(sin_param):
        log.append('AVISO: el parametro "{}" no existe en los rieles, o es de solo lectura. '
                   'La columna que depende de el va a salir vacia.'.format(nombre))
    return donde


# ---------------------------- EL SCHEDULE ----------------------------

def campo_por_nombre(schedulable, nombre):
    for f in schedulable:
        try:
            if f.GetName(doc) == nombre:
                return f
        except Exception:
            continue
    return None


def limpiar_definicion(definition):
    # Deja la definicion en blanco para reconfigurarla desde cero, sin importar como haya
    # quedado en una corrida anterior. Mismo retrofit que usaba la tabla de acero.
    while definition.GetSortGroupFieldCount() > 0:
        definition.RemoveSortGroupField(0)
    while definition.GetFilterCount() > 0:
        definition.RemoveFilter(0)
    for i in range(definition.GetFieldCount() - 1, -1, -1):
        definition.RemoveField(definition.GetField(i).FieldId)


def formato_mm(campo):
    # La copia del largo es un Number sin unidades -guarda 100 y no 0,1 m-, asi que lo unico
    # que hay que decirle es que no ponga decimales ni separador de miles.
    try:
        fo = FormatOptions(UnitTypeId.General)
        fo.Accuracy = 1.0
        try:
            fo.UseGrouping = False
        except Exception:
            pass
        try:
            fo.SuppressTrailingZeros = True
        except Exception:
            pass
        campo.SetFormatOptions(fo)
        return True
    except Exception:
        return False


def poner_titulo(sched, titulo):
    # El titulo que se ve sobre la tabla es el nombre del schedule, y el nombre tiene que ser
    # unico en el documento -uno por lamina-. Asi que el nombre queda "TBL_RIELES_A1" para el
    # navegador y la celda de encabezado se sobreescribe con el titulo del plano tipo.
    try:
        sd = sched.GetTableData().GetSectionData(SectionType.Header)
        if sd is None or sd.NumberOfRows < 1:
            return False
        sd.SetCellText(0, 0, titulo)
        return True
    except Exception:
        return False


def configurar_schedule(sched, numero_lamina):
    definition = sched.Definition
    limpiar_definicion(definition)
    definition.IsItemized = False

    schedulable = definition.GetSchedulableFields()
    faltan = []

    campo_lam = campo_por_nombre(schedulable, param_lamina)
    if campo_lam is None:
        faltan.append(param_lamina)
    campo_tipo = campo_por_nombre(schedulable, param_codigo)
    if campo_tipo is None:
        faltan.append(param_codigo)
    campo_largo = campo_por_nombre(schedulable, param_largo_tbl)
    if campo_largo is None:
        faltan.append(param_largo_tbl)
    campo_item = campo_por_nombre(schedulable, param_item) if param_item else None
    if param_item and campo_item is None:
        faltan.append(param_item)
    if faltan:
        return False, faltan

    # ITEM, TIPO y LARGO en ese orden; el campo del filtro va al final y oculto
    if campo_item is not None:
        f_item = definition.AddField(campo_item)
        f_item.ColumnHeading = H_ITEM
    f_tipo = definition.AddField(campo_tipo)
    f_tipo.ColumnHeading = H_TIPO
    f_largo = definition.AddField(campo_largo)
    f_largo.ColumnHeading = H_LARGO
    formato_mm(f_largo)

    f_lam = definition.AddField(campo_lam)
    try:
        f_lam.IsHidden = True
    except Exception:
        log.append('AVISO {}: no se pudo ocultar la columna "{}"; va a salir impresa en la '
                   'tabla.'.format(numero_lamina, param_lamina))

    definition.AddFilter(ScheduleFilter(f_lam.FieldId, ScheduleFilterType.Contains,
                                        ';{};'.format(numero_lamina)))
    try:
        definition.AddSortGroupField(ScheduleSortGroupField(f_largo.FieldId))
    except Exception:
        pass
    return True, []


def filas_del_cuerpo(sched):
    try:
        sd = sched.GetTableData().GetSectionData(SectionType.Body)
        return sd.NumberOfRows if sd is not None else -1
    except Exception:
        return -1


# ---------------------------- DONDE SE PARA ----------------------------

def rect_util(sheet):
    # area util = bbox de la vineta menos margenes. Identica a usable_rect() de 02, que es
    # la que decide donde caben las vistas.
    col = FilteredElementCollector(doc, sheet.Id).OfCategory(BuiltInCategory.OST_TitleBlocks)
    tb = col.FirstElement()
    if tb is not None:
        bb = tb.get_BoundingBox(sheet)
        if bb is not None:
            return (bb.Min.X + margen, bb.Min.Y + margen,
                    bb.Max.X - margen, bb.Max.Y - margen)
    o = sheet.Outline
    return (o.Min.U + margen, o.Min.V + margen, o.Max.U - margen, o.Max.V - margen)


def ocupado_en(sheet):
    # Rectangulos que la tabla no puede pisar: cada viewport con su titulo, la franja
    # inferior de la vineta y el cajetin.
    rects = []
    for vp in FilteredElementCollector(doc, sheet.Id).OfClass(Viewport):
        for getter in ('GetBoxOutline', 'GetLabelOutline'):
            try:
                o = getattr(vp, getter)()
            except Exception:
                continue
            if o is not None:
                rects.append((o.MinimumPoint.X, o.MinimumPoint.Y,
                              o.MaximumPoint.X, o.MaximumPoint.Y))
    x0, y0, x1, y1 = rect_util(sheet)
    if franja_inferior > 0:
        rects.append((x0 - margen, y0 - margen, x1 + margen, y0 + franja_inferior))
    if cajetin_ancho > 0 and cajetin_alto > 0:
        rects.append((x1 - cajetin_ancho, y0 - margen, x1 + margen, y0 + cajetin_alto))
    return rects


def se_pisan(a, b, holgura):
    return not (a[2] + holgura <= b[0] or b[2] + holgura <= a[0] or
                a[3] + holgura <= b[1] or b[3] + holgura <= a[1])


def buscar_hueco(sheet, ancho, alto):
    # Barrido en grilla sobre el area util: la primera posicion -de las que no pisan nada- que
    # quede mas cerca de la esquina pedida. Es fuerza bruta y esta bien que lo sea: son unos
    # miles de posiciones por lamina y evita toda la maquinaria de "mayor rectangulo vacio",
    # que aca no compra nada.
    x0, y0, x1, y1 = rect_util(sheet)
    if ancho > x1 - x0 or alto > y1 - y0:
        return None
    ocupados = ocupado_en(sheet)
    derecha = 'derecha' in esquina
    arriba = 'arriba' in esquina
    ref_x = x1 - ancho if derecha else x0
    ref_y = y1 - alto if arriba else y0

    mejor = None
    mejor_d = None
    n = int((x1 - x0 - ancho) / PASO_BUSQUEDA) + 1
    m = int((y1 - y0 - alto) / PASO_BUSQUEDA) + 1
    for i in range(max(n, 1)):
        for j in range(max(m, 1)):
            px = x0 + i * PASO_BUSQUEDA
            py = y0 + j * PASO_BUSQUEDA
            if px + ancho > x1 or py + alto > y1:
                continue
            cand = (px, py, px + ancho, py + alto)
            choca = False
            for r in ocupados:
                if se_pisan(cand, r, margen):
                    choca = True
                    break
            if choca:
                continue
            d = math.hypot(px - ref_x, py - ref_y)
            if mejor_d is None or d < mejor_d:
                mejor_d = d
                mejor = cand
    return mejor


def esquina_de_ultimo_recurso(sheet, ancho, alto):
    x0, y0, x1, y1 = rect_util(sheet)
    px = (x1 - ancho) if 'derecha' in esquina else x0
    py = (y1 - alto) if 'arriba' in esquina else y0
    return (px, py, px + ancho, py + alto)


def colocar(sheet, sched, numero_lamina):
    # Se coloca primero -en cualquier lado-, se le mide el bounding box real y recien
    # despues se la manda al hueco. El alto de un schedule depende del tipo de letra y de
    # cuantas filas quedaron: estimarlo es adivinar, y errarle por dos milimetros la deja
    # pisando una vista.
    x0, y0, x1, y1 = rect_util(sheet)
    try:
        ssi = ScheduleSheetInstance.Create(doc, sheet.Id, sched.Id, XYZ(x0, y1, 0.0))
    except Exception as e:
        log.append('ERROR {}: Revit no permitio colocar la tabla ({}).'.format(numero_lamina, e))
        return None
    doc.Regenerate()
    bb = ssi.get_BoundingBox(sheet)
    if bb is None:
        log.append('AVISO {}: no se pudo medir la tabla; queda en la esquina superior '
                   'izquierda.'.format(numero_lamina))
        return ssi
    ancho = bb.Max.X - bb.Min.X
    alto = bb.Max.Y - bb.Min.Y

    destino = buscar_hueco(sheet, ancho, alto)
    if destino is None:
        destino = esquina_de_ultimo_recurso(sheet, ancho, alto)
        log.append('AVISO {}: no hay hueco libre de {:.0f}x{:.0f} mm en la lamina; la tabla '
                   'se coloca en la esquina {} y puede quedar montada sobre una vista.'.format(
                       numero_lamina, ancho * 304.8, alto * 304.8, esquina))
    # el punto de insercion es la esquina SUPERIOR izquierda del schedule
    delta_x = destino[0] - bb.Min.X
    delta_y = destino[3] - bb.Max.Y
    try:
        ssi.Point = XYZ(ssi.Point.X + delta_x, ssi.Point.Y + delta_y, 0.0)
    except Exception as e:
        log.append('AVISO {}: no se pudo mover la tabla al hueco ({}).'.format(numero_lamina, e))
    return ssi


# ---------------------------- EJECUCION ----------------------------

laminas = laminas_de_sector()
if not laminas:
    log.append('No hay laminas con vistas de sector que coincidan con el filtro. Se esperan '
               'laminas con vistas "<sector>{}" o "<sector>{}X", creadas por 01 y 02.'.format(
                   SUF_PLANTA, SUF_ELEV))
else:
    TransactionManager.Instance.EnsureInTransaction(doc)

    mapa = tabla_de_tipos(rieles_del_modelo())
    if not mapa:
        log.append('AVISO: ningun riel del modelo tiene largo legible en "{}"; no hay tabla '
                   'que armar.'.format(param_largo))
    else:
        asegurar_param_numerico(param_largo_tbl)
        marcar_rieles(mapa, laminas)

        schedules = {}
        for v in FilteredElementCollector(doc).OfClass(ViewSchedule):
            schedules[elem_name(v)] = v
        instancias = {}
        for ssi in FilteredElementCollector(doc).OfClass(ScheduleSheetInstance):
            instancias.setdefault(ssi.ScheduleId.Value, []).append(ssi)

        puestas = 0
        for sh, sector, vistas in laminas:
            numero = sh.SheetNumber
            nombre_sched = PREFIJO_SCHEDULE + numero
            tipos = sorted(set(mapa[largo_mm(el)] for el in rieles_de_lamina(vistas)
                               if largo_mm(el) in mapa))
            if not tipos:
                log.append('{} ({}): no se ve ningun riel en las vistas de la lamina; no se '
                           'pone tabla.'.format(numero, sector))
                continue

            sched = schedules.get(nombre_sched)
            if sched is not None and not rehacer:
                log.append('{} ({}): ya tiene tabla, se salta. Corre con rehacer para '
                           'reconfigurarla.'.format(numero, sector))
                continue
            if sched is None:
                sched = ViewSchedule.CreateSchedule(
                    doc, ElementId(BuiltInCategory.OST_ElectricalFixtures))
                try:
                    sched.Name = nombre_sched
                except Exception as e:
                    log.append('AVISO {}: no se pudo nombrar la tabla "{}" ({}); queda con '
                               'el nombre que le puso Revit.'.format(numero, nombre_sched, e))
                schedules[nombre_sched] = sched

            ok, faltan = configurar_schedule(sched, numero)
            if not ok:
                log.append('ERROR {}: los rieles no tienen estos parametros como campo de '
                           'schedule: {}. Sin ellos la tabla no se puede armar.'.format(
                               numero, ', '.join(faltan)))
                continue
            doc.Regenerate()
            if not poner_titulo(sched, titulo_tabla):
                log.append('AVISO {}: no se pudo escribir el titulo "{}" en la tabla; queda '
                           'el nombre del schedule.'.format(numero, titulo_tabla))

            # una fila de mas es el encabezado de columnas; muchas mas significa que Revit
            # no colapso y esta imprimiendo un riel por fila
            filas = filas_del_cuerpo(sched)
            if filas > len(tipos) + 1:
                log.append('AVISO {}: la tabla quedo con {} fila(s) y en la lamina se ven {} '
                           'tipo(s). Si son muchas mas, Revit no esta colapsando las filas '
                           '-mira la nota del encabezado sobre "Itemize"-.'.format(
                               numero, filas, len(tipos)))

            for vieja in instancias.get(sched.Id.Value, []):
                try:
                    doc.Delete(vieja.Id)
                except Exception:
                    pass
            if colocar(sh, sched, numero) is not None:
                puestas += 1
                log.append('OK {} ({}): tabla con {} tipo(s): {}.'.format(
                    numero, sector, len(tipos),
                    ', '.join(codigo_de(t) for t in tipos)))

        log.insert(0, '{} tabla(s) de rieles en {} lamina(s) de sector.'.format(
            puestas, len(laminas)))

    TransactionManager.Instance.ForceCloseTransaction()

OUT = log
# ----------------------------------------
log = Watch(py_tabla_de_tipos_de_riel_por)  # graph output
