# Dynamo graph 08_Conduits - tags de circuito.dyn (Dynamo 4.0.2.3852)
# Etiqueta cada conduit con su numero de circuito y apila en grilla los tags de los que se superponen en planta.

n01_procesar_todos_los_sectores = BoolSelector(false)  # "01. Procesar TODOS los sectores"; graph input
n02_filtro_de_sectores_si_todos = StringInput("SECTOR A")  # "02. Filtro de sectores (si TODOS = False)"; graph input
n03_parametro_de_donde_se_lee_el = StringInput("NUM_CIRCUITO")  # "03. Parametro de donde se LEE el numero de circuito"; graph input
n04_parametro_que_dibuja_el_tag = StringInput("TAG CIRCUITO")  # "04. Parametro que DIBUJA el tag (vacio = el mismo de 03)"; graph input
n05_marca_para_el_conduit_sin = StringInput("X")  # "05. Marca para el conduit sin circuito (vacio = no se etiqueta)"; graph input
n06_familia_del_tag_de_circuito = StringInput("Tag de Cto Tuberia")  # "06. Familia del tag de circuito"; graph input
n07_umbral_de_superposicion_en = IntegerSlider(3, range=0..50 step 1)  # "07. Umbral de superposicion en planta (mm de papel)"; graph input
n08_separacion_del_apilado = IntegerSlider(12, range=0..100 step 1)  # "08. Separacion del apilado respecto al conduit (mm)"; graph input
n09_circulos_por_columna_antes_de = IntegerSlider(2, range=1..10 step 1)  # "09. Circulos por columna antes de abrir la siguiente"; graph input
n10_diametro_del_circulo_mm_de = IntegerSlider(0, range=0..40 step 1)  # "10. Diametro del circulo (mm de papel; 0 = medirlo)"; graph input
n11_rehacer_los_tags_existentes = BoolSelector(false)  # "11. Rehacer los tags existentes"; graph input
n12_limpieza_borrar_este_valor = StringInput("")  # "12. LIMPIEZA: borrar este valor del parametro de 03 (vacio = no limpiar)"; graph input
n13_etiquetar_tambien_los = BoolSelector(true)  # "13. Etiquetar tambien los conduits verticales (bajadas)"; graph input
python_script = Python(IN[0]=n01_procesar_todos_los_sectores, IN[1]=n02_filtro_de_sectores_si_todos, IN[2]=n03_parametro_de_donde_se_lee_el, IN[3]=n04_parametro_que_dibuja_el_tag, IN[4]=n05_marca_para_el_conduit_sin, IN[5]=n06_familia_del_tag_de_circuito, IN[6]=n07_umbral_de_superposicion_en, IN[7]=n08_separacion_del_apilado, IN[8]=n09_circulos_por_columna_antes_de, IN[9]=n10_diametro_del_circulo_mm_de, IN[10]=n11_rehacer_los_tags_existentes, IN[11]=n12_limpieza_borrar_este_valor, IN[12]=n13_etiquetar_tambien_los)  # PythonNet3
# ---------- python_script.python (741 lines) ----------
# 08_Conduits - tags de circuito - ILUMINACION
#
# Etiqueta cada conduit de las plantas de sector con el numero de circuito al que pertenece,
# y cuando varios conduits se superponen en planta apila sus tags en una grilla para que se
# lean todos.
#
#            |                    |                     |
#            O  <- la flecha      O                     O
#
#          (3)                  (3)                 (3) (5)
#                               (4)                 (4) (6)
#
#          1 conduit          2 conduits            4 conduits
#
# Revit 2027 / Dynamo 4 / CPython3
# IN[0]  = procesar todos los sectores (bool)
# IN[1]  = filtro de sectores si IN[0] es False (parcial, comas)
# IN[2]  = parametro de donde se LEE el numero de circuito (string, ej. NUM_CIRCUITO)
# IN[3]  = parametro que DIBUJA la familia del tag (string; vacio = dibuja el mismo de IN[2] y
#          no se copia nada)
# IN[4]  = texto para el conduit sin numero (string, ej. X; vacio = no se etiqueta)
# IN[5]  = familia del tag de circuito (string, ej. Tag de Cto Tuberia)
# IN[6]  = umbral de superposicion en planta, en mm de papel
# IN[7]  = separacion del apilado respecto al conduit, en mm de papel
# IN[8]  = cuantos circulos entran en una columna antes de abrir la siguiente (int)
# IN[9]  = diametro del circulo del tag, en mm de papel (0 = medirlo del tag colocado)
# IN[10] = rehacer: borra los tags que ya estan puestos y los vuelve a colocar
# IN[11] = LIMPIEZA: borra este valor del parametro de IN[2] en todo el modelo (vacio = no)
# IN[12] = etiquetar tambien los conduits verticales, o sea las bajadas (bool)
#
#
# QUE ES "SUPERPUESTO" -Y POR QUE EL UMBRAL VA EN MILIMETROS DE PAPEL-
#
# Los conduits no estan encimados en el modelo: corren PARALELOS Y SEPARADOS. Los tres
# primeros del modelo van a 100 mm uno de otro, que a 1:75 son 1,3 mm en la hoja. O sea que el
# problema no es geometrico sino de ESCALA: dos conduits se superponen cuando el plotter ya no
# puede separarlos, y eso depende de a cuanto se imprime la vista.
#
# Por eso el umbral de IN[6] es en mm de PAPEL y se convierte con la escala de cada vista,
# igual que todas las distancias de 03, 05 y 06. Un umbral en milimetros de modelo daria
# grupos distintos segun la escala sin que nadie toque el modelo.
#
# Dos conduits van al mismo grupo si ademas de estar cerca son PARALELOS y se SOLAPAN a lo
# largo. Sin esas dos condiciones, dos conduits que apenas se cruzan en un punto -uno yendo al
# norte y otro al este- caerian en el mismo grupo y su anotacion diria una mentira: que en ese
# lugar corren juntos.
#
#
# UN CIRCULO POR CIRCUITO DISTINTO, MOVIDO A SU CASILLA
#
# La anotacion apilada NO es un tag con varios valores: son N IndependentTag corridos a las
# posiciones de la grilla. Solo el primero conserva la flecha; los demas van sin.
#
# N NO es la cantidad de conduits del grupo, sino la cantidad de CIRCUITOS DISTINTOS que pasan
# por ahi. Una corrida que va junta lleva muchas veces el mismo circuito repetido -tres tramos
# del 3 y uno del 4- y dibujarlos todos daba pilas de cinco circulos que decian "3 3 4 3 3". El
# apilado existe para mostrar QUE CIRCUITOS pasan por ese lugar, y para eso el 3 hace falta una
# vez: repetirlo no agrega informacion, agrega tinta y esconde el 4.
#
# Se colapsa SOLO dentro del grupo. Que el circuito 3 tenga su propio circulo en otra parte de
# la planta es correcto, y es justamente lo que el plano tiene que decir: por ahi tambien pasa.
#
# Lo que NO se colapsa es la copia al parametro que dibuja el tag: esa se escribe en TODOS los
# conduits del grupo. Es un dato del modelo -el circuito de ese tramo- y no tiene por que
# depender de a quien le toco representarlo en el dibujo.
#
# Se eligio asi para que cada circulo siga siendo un tag DE VERDAD, asociativo a SU conduit: si
# alguien cambia el circuito de uno, ese circulo se actualiza solo y los otros no se enteran.
# Un unico tag multi-referencia habria dejado el apilado en manos de Revit, que no da la grilla
# de dos columnas que pide el plano.
#
# El precio: la grilla la sostiene el graph, no Revit. Si alguien mueve un circulo a mano, el
# apilado se desalinea y no hay nada que lo vuelva a acomodar salvo correr el paso con rehacer.
#
# La grilla se llena HACIA ABAJO hasta IN[8] circulos y despues abre columna a la derecha, que
# es como esta en el plano de referencia: con cuatro circuitos, el 3 y el 5 arriba y el 4 y el
# 6 abajo.
#
#
# EL PASO DE LA GRILLA SE MIDE, NO SE ESTIMA
#
# El tamano del circulo depende de la familia del tag y de la escala de la vista, asi que se
# coloca el primer tag, se le mide el bounding box en la vista y ese es el paso de la grilla.
# Estimarlo por el tamano de letra seria adivinar, y errarle deja los circulos separados o
# encimados. Es el mismo criterio con que 04 y 07 miden la tabla antes de moverla.
#
# IN[9] existe como valvula de escape: si Revit no devuelve el bounding box del tag -pasa con
# algunas familias de anotacion- se usa ese numero y el log lo avisa.
#
#
# LA TRAMPA DEL PARAMETRO QUE DIBUJA EL TAG
#
# Un IndependentTag dibuja LO QUE DICE SU FAMILIA, no lo que le pase el graph. Y ninguna API
# dice que parametro dibuja el label de una anotacion: hay que saberlo o descubrirlo mirando.
#
# Esto ya costo caro en 03. Se probo etiquetar los rieles con un tag de categoria y los 195
# tags salieron VACIOS, porque la familia dibujaba un parametro distinto del que el graph
# escribia. No hubo ningun error: solo 195 hexagonos en blanco.
#
# En este modelo el conduit tiene varios candidatos -NUM_CIRCUITO, TAG CIRCUITO, TEXTO CIRCUITO
# 1/2/3- y no se puede saber desde afuera cual usa "Tag de Cto Tuberia". Por eso hay DOS
# inputs:
#
#   IN[2]  de donde se LEE el numero      el dato de verdad, NUM_CIRCUITO
#   IN[3]  que parametro DIBUJA el tag    vacio si es el mismo; si no, se copia
#
# Si el tag dibuja otro parametro, se pone su nombre en IN[3] y el graph copia el numero ahi.
# Es la misma maquinaria que usa 04 para el largo del riel, y por el mismo motivo: el dato vive
# donde tiene que vivir y ademas se copia donde el dibujo lo necesita.
#
# QUE MIRAR EN EL PRIMER RUN: que los circulos salgan CON NUMERO. Si salen todos vacios, el tag
# no dibuja el parametro de IN[3] y hay que cambiarlo. El graph no puede detectarlo solo.
#
# EN ESTE MODELO YA SE COMPROBO, Y LA TRAMPA ERA REAL: "Tag de Cto Tuberia" dibuja
# "TAG CIRCUITO", NO "NUM_CIRCUITO". Se vio filtrando el modelo: hay 2 conduits con
# TAG CIRCUITO = "23" y en el plano hay exactamente 2 circulos con 23, mientras que conduits
# con NUM_CIRCUITO = "23" hay CERO. Por eso IN[3] va en "TAG CIRCUITO".
#
# La primera corrida fue con IN[3] vacio y el resultado fue el peor posible: los circulos
# salieron en blanco -porque el tag miraba TAG CIRCUITO, que estaba a medias- y ademas la marca
# "X" se escribio sobre NUM_CIRCUITO en 116 conduits. Para eso esta IN[11].
#
#
# LA X DE LOS QUE NO TIENEN CIRCUITO
#
# Hoy solo algunos conduits tienen el numero cargado. Los que no lo tienen se etiquetan igual,
# con el texto de IN[4] -una X- para que el hueco se VEA en el plano en vez de pasar
# desapercibido. Es la misma idea que la columna vacia de 07: un dato que falta tiene que
# notarse.
#
# ⚠️ OJO CON DONDE CAE ESA X. Como el tag dibuja un parametro del conduit, la X hay que
# ESCRIBIRLA en el modelo. Si IN[3] es un parametro de dibujo aparte, la X vive ahi y
# NUM_CIRCUITO no se toca, que es lo correcto. Pero si el tag dibuja NUM_CIRCUITO directo, la X
# termina en el dato de verdad y despues no se distingue de un valor cargado a mano. El graph
# lo avisa en el log cuando pasa; para desactivarlo se deja IN[4] vacio y esos conduits no se
# etiquetan.
#
#
# QUE SE ETIQUETA Y QUE NO
#
# Solo las PLANTAS de sector, y solo la categoria Conduits. Las elevaciones no se tocan: el
# apilado resuelve un problema de la planta -conduits paralelos que a escala se juntan- y en
# una elevacion el mismo grupo se ve de canto.
#
# Los Conduit Fittings quedan fuera: son codos y uniones, no llevan circuito propio y
# etiquetarlos duplicaria el numero del tramo que unen.
#
# Los 79 tags de esta familia que ya hay en el modelo estan en otras vistas -el plano de
# referencia DISPOSICION GENERAL ALUMBRADO- y no se tocan, porque los tags se recolectan
# CONTRA LA VISTA que se esta procesando.

import clr
import math
clr.AddReference('RevitAPI')
clr.AddReference('RevitServices')
from Autodesk.Revit.DB import (FilteredElementCollector, ViewPlan, XYZ, Element, ElementId,
                               BuiltInCategory, StorageType, FamilySymbol, Reference,
                               IndependentTag, TagOrientation, LocationCurve)
from RevitServices.Persistence import DocumentManager
from RevitServices.Transactions import TransactionManager

doc = DocumentManager.Instance.CurrentDBDocument

process_all = bool(IN[0])
filter_text = (IN[1] or '').strip()
param_lee = (IN[2] or 'NUM_CIRCUITO').strip()
param_dibuja = (IN[3] or '').strip()
texto_sin = (IN[4] or '').strip()
familia_tag = (IN[5] or '').strip()
umbral_mm = float(IN[6]) if IN[6] is not None else 3.0
sep_mm = float(IN[7]) if IN[7] is not None else 12.0
por_columna = int(IN[8]) if IN[8] else 2
diam_mm_in = float(IN[9]) if IN[9] is not None else 0.0
rehacer = bool(IN[10])
limpiar_valor = (IN[11] or '').strip()
taggear_verticales = bool(IN[12]) if IN[12] is not None else True

log = []
aviso_medida = False
aviso_x_en_origen = False

# --- contrato de nombres con 00_Vistas de sector ---
SUF_PLANTA = ' - PLANTA'

# Dos conduits se consideran paralelos si sus direcciones en planta difieren menos que esto.
# Es angulo, no distancia, asi que no depende de la escala.
TOL_PARALELO = 0.02  # rad, poco mas de un grado


def elem_name(e):
    try:
        return Element.Name.GetValue(e)
    except Exception:
        try:
            return e.Name
        except Exception:
            return ''


def coincide(nombre, texto):
    # filtro parcial separado por comas, insensible a mayusculas. Mismo criterio que el resto
    # del pipeline.
    if not texto:
        return True
    alto = (nombre or '').upper()
    for t in texto.split(','):
        t = t.strip().upper()
        if t and t in alto:
            return True
    return False


def plantas_de_sector():
    res = []
    for v in FilteredElementCollector(doc).OfClass(ViewPlan):
        if v.IsTemplate:
            continue
        n = elem_name(v)
        if not n.endswith(SUF_PLANTA):
            continue
        sector = n[:-len(SUF_PLANTA)]
        if not process_all and not coincide(sector, filter_text):
            continue
        res.append((v, sector, n))
    res.sort(key=lambda t: t[2])
    return res


def get_string(el, nombre):
    if not nombre:
        return ''
    try:
        p = el.LookupParameter(nombre)
    except Exception:
        return ''
    if p is None or p.StorageType != StorageType.String:
        return ''
    try:
        return (p.AsString() or '').strip()
    except Exception:
        return ''


def set_string(el, nombre, valor):
    if not nombre:
        return None
    try:
        p = el.LookupParameter(nombre)
    except Exception:
        return None
    if p is None or p.IsReadOnly or p.StorageType != StorageType.String:
        return False
    try:
        if (p.AsString() or '') != valor:
            p.Set(valor)
        return True
    except Exception:
        return False


def tipo_de_tag():
    # Se busca por NOMBRE DE FAMILIA y no por nombre de tipo: la familia tiene un solo tipo hoy,
    # pero si manana le agregan uno el graph no tiene por que romperse.
    objetivo = familia_tag.upper()
    candidatos = []
    for s in (FilteredElementCollector(doc)
              .OfCategory(BuiltInCategory.OST_ConduitTags)
              .WhereElementIsElementType()):
        if not isinstance(s, FamilySymbol):
            continue
        try:
            fam = s.Family.Name or ''
        except Exception:
            fam = ''
        candidatos.append((fam, s))
        if objetivo and fam.upper() == objetivo:
            return s
    if objetivo:
        log.append('ERROR: no existe una familia de tag de conduit llamada "{}". Las que hay '
                   'en el modelo son: {}.'.format(
                       familia_tag,
                       ', '.join(sorted(set(f for f, _ in candidatos))) or 'ninguna'))
        return None
    if candidatos:
        s = candidatos[0][1]
        log.append('AVISO: no se pidio familia de tag; se usa "{}".'.format(candidatos[0][0]))
        return s
    log.append('ERROR: el modelo no tiene ninguna familia de tag de conduit cargada.')
    return None


# ---------------------------- GEOMETRIA EN PLANTA ----------------------------

def eje_en_planta(el, v, ex, ey):
    # El conduit reducido a un segmento en las coordenadas de la vista: (u0, w0) - (u1, w1).
    # Se usa la LocationCurve y no el bounding box porque un conduit diagonal tiene un bbox
    # enorme que no dice nada de por donde pasa.
    try:
        loc = el.Location
    except Exception:
        return None
    if not isinstance(loc, LocationCurve) or loc.Curve is None:
        return None
    try:
        c = loc.Curve
        p0, p1 = c.GetEndPoint(0), c.GetEndPoint(1)
    except Exception:
        return None
    a = (p0.DotProduct(ex), p0.DotProduct(ey))
    b = (p1.DotProduct(ex), p1.DotProduct(ey))
    # Un conduit VERTICAL en planta es un punto: no tiene direccion, asi que no puede
    # agruparse con nadie. Se devuelve igual como segmento degenerado y termina siendo un
    # grupo de uno, porque una bajada es justamente donde interesa saber el circuito. Las
    # primeras corridas lo descartaban y se perdian 67 de 202 conduits sin que nada lo dijera
    # salvo una linea del log.
    return a, b


def direccion(seg):
    a, b = seg
    du, dw = b[0] - a[0], b[1] - a[1]
    n = math.hypot(du, dw)
    if n < 1e-12:
        return None
    return du / n, dw / n


def mismo_grupo(s1, s2, umbral):
    # Tres condiciones, y las tres hacen falta.
    d1, d2 = direccion(s1), direccion(s2)
    if d1 is None or d2 is None:
        return False

    # 1. PARALELOS. El valor absoluto es para que dos conduits dibujados en sentido contrario
    #    -uno de norte a sur y otro de sur a norte- cuenten como paralelos, que es lo que son.
    cos = abs(d1[0] * d2[0] + d1[1] * d2[1])
    if cos < math.cos(TOL_PARALELO):
        return False

    # 2. CERCA, medido perpendicular al eje. La distancia entre los puntos medios no sirve: dos
    #    conduits de la misma corrida, uno corto y uno largo, tienen los medios lejos y estan
    #    encimados igual.
    a1 = s1[0]
    a2, b2 = s2
    nu, nw = -d1[1], d1[0]
    perp1 = abs((a2[0] - a1[0]) * nu + (a2[1] - a1[1]) * nw)
    perp2 = abs((b2[0] - a1[0]) * nu + (b2[1] - a1[1]) * nw)
    if min(perp1, perp2) > umbral:
        return False

    # 3. SE SOLAPAN a lo largo del eje. Sin esto, dos tramos de la misma linea que estan en
    #    puntas opuestas de la planta -y no comparten ni un metro- irian al mismo grupo y su
    #    anotacion diria que ahi corren juntos.
    def rango(s):
        x = [(p[0] - a1[0]) * d1[0] + (p[1] - a1[1]) * d1[1] for p in s]
        return min(x), max(x)
    r1, r2 = rango(s1), rango(s2)
    return not (r1[1] < r2[0] - umbral or r2[1] < r1[0] - umbral)


def agrupar(items, umbral):
    # Union-find simple. Son decenas de conduits por planta, asi que el O(n^2) no molesta y
    # evita toda la maquinaria de indices espaciales.
    padre = list(range(len(items)))

    def raiz(i):
        while padre[i] != i:
            padre[i] = padre[padre[i]]
            i = padre[i]
        return i

    for i in range(len(items)):
        for j in range(i + 1, len(items)):
            if raiz(i) == raiz(j):
                continue
            if mismo_grupo(items[i][1], items[j][1], umbral):
                padre[raiz(j)] = raiz(i)

    grupos = {}
    for i in range(len(items)):
        grupos.setdefault(raiz(i), []).append(items[i])
    return list(grupos.values())


def clave_de_orden(texto):
    # Los circuitos se ordenan como numeros cuando lo son -3, 4, 5, 10 y no 10, 3, 4, 5- y los
    # que no lo son van al final por orden alfabetico. Los sin circuito, ultimos de todos.
    if not texto:
        return (2, 0, '')
    try:
        return (0, int(texto), '')
    except ValueError:
        return (1, 0, texto.upper())


def medir_tag(tag, v, ex, ey):
    try:
        bb = tag.get_BoundingBox(v)
    except Exception:
        bb = None
    if bb is None:
        return None
    us, ws = [], []
    for x in (bb.Min.X, bb.Max.X):
        for y in (bb.Min.Y, bb.Max.Y):
            for z in (bb.Min.Z, bb.Max.Z):
                p = XYZ(x, y, z)
                us.append(p.DotProduct(ex))
                ws.append(p.DotProduct(ey))
    ancho, alto = max(us) - min(us), max(ws) - min(ws)
    if ancho < 1e-9 or alto < 1e-9:
        return None
    return ancho, alto


def proyectar(p, v):
    n = v.ViewDirection.Normalize()
    d = p.Subtract(v.Origin).DotProduct(n)
    return p.Subtract(n.Multiply(d))


def medir_paso(v, sym, conduit, ex, ey):
    # Coloca un tag de prueba, lo mide y lo borra. Hace falta conocer el tamano del circulo
    # ANTES de decidir donde cae cada pila -si no, no hay con que comparar para saber si dos se
    # pisan- y el tamano depende de la familia y de la escala de la vista.
    escala = v.Scale or 1
    papel = lambda mm: float(mm) / 304.8 * escala
    m = None
    try:
        bb = conduit.get_BoundingBox(v)
        pt = XYZ((bb.Min.X + bb.Max.X) / 2.0, (bb.Min.Y + bb.Max.Y) / 2.0,
                 (bb.Min.Z + bb.Max.Z) / 2.0) if bb else v.Origin
        prueba = IndependentTag.Create(doc, sym.Id, v.Id, Reference(conduit), False,
                                       TagOrientation.Horizontal, proyectar(pt, v))
        doc.Regenerate()
        m = medir_tag(prueba, v, ex, ey)
        doc.Delete(prueba.Id)
    except Exception:
        m = None
    if m is not None:
        return m
    global aviso_medida
    d_mm = diam_mm_in if diam_mm_in > 0 else 8.0
    if not aviso_medida:
        aviso_medida = True
        log.append('AVISO: Revit no devolvio el tamano del tag; la grilla usa {:.1f} mm de '
                   'papel. Si los circulos quedan separados o encimados, ajustar IN[9].'.format(
                       d_mm))
    return (papel(d_mm), papel(d_mm))


def posiciones_de_pila(ancla_u, ancla_w, cuantos, paso, sep):
    # La grilla: hacia abajo hasta "por_columna" y despues columna nueva a la derecha.
    res = []
    for i in range(cuantos):
        col, fil = divmod(i, max(por_columna, 1))
        res.append((ancla_u + col * paso[0],
                    ancla_w - sep - paso[1] / 2.0 - fil * paso[1]))
    return res


def desplazamientos(paso):
    # Por donde se prueba correr una pila que choca. Primero mas abajo -la pila sigue colgando
    # del mismo lugar, que es lo que la hace legible- y solo despues a los costados.
    yield (0.0, 0.0)
    for k in range(1, 7):
        yield (0.0, -k * paso[1] * 1.1)
    for k in range(1, 4):
        for signo in (1.0, -1.0):
            yield (signo * k * paso[0] * 1.2, 0.0)
            yield (signo * k * paso[0] * 1.2, -k * paso[1] * 1.1)


def libre(centros, ocupados, paso):
    # Dos circulos se pisan si sus centros estan a menos de un diametro. Se compara con el lado
    # mas chico del tag para no separar de mas cuando el circulo no es redondo.
    minimo = min(paso[0], paso[1]) * 0.95
    for u, w in centros:
        for ou, ow in ocupados:
            if math.hypot(u - ou, w - ow) < minimo:
                return False
    return True


def tags_de_la_familia(v, sym_id):
    res = []
    for t in FilteredElementCollector(doc, v.Id).OfClass(IndependentTag):
        try:
            if t.GetTypeId().Value == sym_id.Value:
                res.append(t.Id)
        except Exception:
            pass
    return res


# ---------------------------- EL TRABAJO DE UNA PLANTA ----------------------------

def taggear_planta(v, sym, ex, ey):
    global aviso_medida, aviso_x_en_origen
    escala = v.Scale or 1
    papel = lambda mm: float(mm) / 304.8 * escala
    umbral = papel(umbral_mm)
    sep = papel(sep_mm)

    existentes = tags_de_la_familia(v, sym.Id)
    if existentes and not rehacer:
        return 0, 0, 0, True
    for tid in existentes:
        try:
            doc.Delete(tid)
        except Exception:
            pass

    conduits = [el for el in FilteredElementCollector(doc, v.Id)
                .OfCategory(BuiltInCategory.OST_Conduit)
                .WhereElementIsNotElementType()]
    if not conduits:
        return 0, 0, 0, False

    items = []
    sin_eje = 0
    verticales = 0
    for el in conduits:
        seg = eje_en_planta(el, v, ex, ey)
        if seg is None:
            sin_eje += 1
            continue
        if direccion(seg) is None:
            verticales += 1
            if not taggear_verticales:
                continue
        items.append((el, seg))
    if sin_eje:
        log.append('  {}: {} conduit(s) sin curva de recorrido; no se etiquetan.'.format(
            elem_name(v), sin_eje))
    if verticales:
        log.append('  {}: {} conduit(s) verticales -bajadas-{}.'.format(
            elem_name(v), verticales,
            ', cada uno con su propio circulo' if taggear_verticales else ', no se etiquetan'))
    if not items:
        return 0, 0, 0, False

    # El paso de la grilla se mide ANTES de empezar, con un tag de prueba que se borra: hace
    # falta conocerlo para poder decidir donde cae cada pila sin pisar a las de al lado, y eso
    # se decide antes de crear ningun tag definitivo.
    paso = medir_paso(v, sym, items[0][0], ex, ey)

    grupos = agrupar(items, umbral)
    # las pilas se colocan de arriba a abajo y de izquierda a derecha para que el resultado no
    # dependa del orden en que Revit devolvio los conduits
    grupos.sort(key=lambda g: (-max(p[1] for p in g[0][1]), min(p[0] for p in g[0][1])))
    puestos = 0
    sin_numero = 0
    colapsados = 0
    ocupados = []

    for grupo in grupos:
        # cada conduit del grupo con su numero, ya ordenados
        filas = []
        for el, seg in grupo:
            num = get_string(el, param_lee)
            es_marca = not num
            if es_marca:
                sin_numero += 1
                if not texto_sin:
                    continue
                num = texto_sin
            filas.append((clave_de_orden('' if es_marca else num), num, es_marca, el, seg))
        if not filas:
            continue
        filas.sort(key=lambda f: (f[0], f[3].Id.Value))

        # UN CIRCULO POR CIRCUITO DISTINTO, no uno por conduit.
        #
        # Una corrida de conduits que van juntos lleva muchas veces el mismo circuito repetido
        # -tres tramos del circuito 3 y uno del 4-, y dibujarlos todos daba pilas de cinco
        # circulos que decian "3 3 4 3 3". El apilado existe para mostrar QUE CIRCUITOS pasan
        # por ahi, y para eso el 3 hace falta una vez. Repetirlo no agrega informacion: agrega
        # tinta y esconde el 4.
        #
        # Se colapsa SOLO dentro del grupo. Que el circuito 3 tenga su propio circulo en otra
        # parte de la planta es correcto y es justamente lo que dice el plano: por ahi tambien
        # pasa el 3.
        #
        # Ojo con lo que NO se colapsa: la copia al parametro que dibuja el tag se sigue
        # escribiendo en TODOS los conduits del grupo, tengan circulo o no. Esa copia es un
        # dato del modelo -el numero de circuito de ese tramo- y no tiene por que depender de
        # si al tramo le toco o no ser el representante en el dibujo.
        representantes = []
        vistos = set()
        for f in filas:
            if f[1] in vistos:
                continue
            vistos.add(f[1])
            representantes.append(f)
        colapsados += len(filas) - len(representantes)

        # el ancla: el punto medio del tramo que comparten, sobre el eje del primero. Un grupo
        # de una bajada no tiene eje, asi que su ancla es el punto mismo.
        d = direccion(filas[0][4])
        a1 = filas[0][4][0]
        if d is None:
            ancla_u, ancla_w = a1[0], a1[1]
        else:
            proyecciones = []
            for f in filas:
                for p in f[4]:
                    proyecciones.append((p[0] - a1[0]) * d[0] + (p[1] - a1[1]) * d[1])
            t_medio = (min(proyecciones) + max(proyecciones)) / 2.0
            ancla_u = a1[0] + d[0] * t_medio
            ancla_w = a1[1] + d[1] * t_medio

        # DONDE CAE LA PILA. Se prueba colgando del ancla y, si algun circulo pisaria uno ya
        # puesto, se baja la pila entera de a un circulo y despues se prueba a los costados.
        # Sin esto, dos corridas paralelas cercanas dejan sus pilas montadas: en el plano se
        # leen como UNA sola columna larga y se pierde justamente la convencion de dos por
        # columna. Se mueve la pila COMPLETA y no cada circulo, porque una pila desarmada ya
        # no dice que esos circuitos van juntos.
        # La COPIA al parametro que dibuja el tag va sobre TODOS los conduits del grupo, tengan
        # circulo o no: es un dato del modelo y no depende de a quien le toco representar al
        # circuito en el dibujo.
        destino = param_dibuja or param_lee
        for _clave, num, es_marca, el, _seg in filas:
            if destino != param_lee:
                set_string(el, destino, num)
            elif es_marca:
                # Si el tag dibuja el mismo parametro del que se lee, la marca de los sin
                # circuito cae sobre el dato de verdad. Se hace igual -es lo que se pidio- pero
                # se avisa una vez, porque despues no se distingue de un valor cargado a mano.
                if not aviso_x_en_origen:
                    aviso_x_en_origen = True
                    log.append('AVISO: la marca "{}" de los conduits sin circuito se escribe '
                               'en "{}", que es el parametro del dato de verdad, asi que '
                               'despues no se distingue de un valor cargado a mano. La salida '
                               'limpia es poner en IN[3] el parametro que dibuja el tag; para '
                               'no marcarlos, vaciar IN[4].'.format(texto_sin, param_lee))
                set_string(el, destino, num)

        centros = posiciones_de_pila(ancla_u, ancla_w, len(representantes), paso, sep)
        for du, dw in desplazamientos(paso):
            prueba = [(u + du, w + dw) for u, w in centros]
            if libre(prueba, ocupados, paso):
                centros = prueba
                break
        ocupados.extend(centros)

        for i, (_clave, num, es_marca, el, _seg) in enumerate(representantes):
            try:
                pt = proyectar(ex.Multiply(ancla_u).Add(ey.Multiply(ancla_w)), v)
                tag = IndependentTag.Create(doc, sym.Id, v.Id, Reference(el), i == 0,
                                            TagOrientation.Horizontal, pt)
            except Exception:
                continue

            u, w = centros[i]
            try:
                tag.TagHeadPosition = proyectar(ex.Multiply(u).Add(ey.Multiply(w)), v)
            except Exception:
                pass
            if i != 0:
                try:
                    tag.HasLeader = False
                except Exception:
                    pass
            puestos += 1

    return puestos, sin_numero, colapsados, False


# ---------------------------- EJECUCION ----------------------------

plantas = plantas_de_sector()
if not plantas:
    log.append('No hay plantas de sector que coincidan con el filtro. Se esperan vistas '
               '"<sector>{}", creadas por 00.'.format(SUF_PLANTA))
else:
    TransactionManager.Instance.EnsureInTransaction(doc)

    # LIMPIEZA. Herramienta de una sola vez, como el diagnostico de notas de 05: se le pasa un
    # valor y lo borra de TODOS los conduits del modelo que lo tengan en el parametro de
    # lectura. Existe porque la primera corrida de este paso escribio la marca "X" sobre
    # NUM_CIRCUITO -el parametro del dato de verdad- en los 116 conduits que estaban vacios, y
    # esas X no se van solas por mas que despues se configure bien el parametro de dibujo.
    #
    # Va sobre todo el modelo y no sobre los sectores filtrados a proposito: el destrozo no
    # sabe de sectores y limpiarlo a medias seria peor que no limpiarlo.
    if limpiar_valor:
        borradas = 0
        for el in (FilteredElementCollector(doc)
                   .OfCategory(BuiltInCategory.OST_Conduit)
                   .WhereElementIsNotElementType()):
            if get_string(el, param_lee) == limpiar_valor:
                if set_string(el, param_lee, ''):
                    borradas += 1
        log.append('LIMPIEZA: se borro el valor "{}" de "{}" en {} conduit(s). Vaciar IN[11] '
                   'para que no vuelva a correr.'.format(limpiar_valor, param_lee, borradas))

    sym = tipo_de_tag()
    if sym is not None:
        try:
            if not sym.IsActive:
                sym.Activate()
                doc.Regenerate()
        except Exception:
            pass

        total, total_sin, total_col, saltadas = 0, 0, 0, 0
        for v, sector, nombre in plantas:
            ex = v.RightDirection.Normalize()
            ey = v.UpDirection.Normalize()
            puestos, sin_num, col, saltada = taggear_planta(v, sym, ex, ey)
            if saltada:
                saltadas += 1
                log.append('  {}: ya tiene tags de esta familia, se salta. Corre con rehacer '
                           'para volver a colocarlos.'.format(nombre))
                continue
            total += puestos
            total_sin += sin_num
            total_col += col
            log.append('  {}: {} tag(s) de circuito.'.format(nombre, puestos))

        log.insert(0, '{} tag(s) de circuito en {} planta(s) de sector{}.'.format(
            total, len(plantas) - saltadas,
            ' ({} saltada(s))'.format(saltadas) if saltadas else ''))
        if total_col:
            log.append('{} tag(s) no se dibujaron porque repetian un circuito que ya estaba en '
                       'su misma pila. Un circuito se muestra UNA vez por grupo: repetirlo no '
                       'agrega informacion y esconde a los demas.'.format(total_col))
        if total_sin:
            log.append('{} conduit(s) no tienen "{}" cargado{}.'.format(
                total_sin, param_lee,
                '; salen con la marca "{}"'.format(texto_sin) if texto_sin
                else ' y no se etiquetaron'))
        log.append('MIRAR EN EL PRIMER RUN: que los circulos salgan CON NUMERO. Si salen todos '
                   'vacios, la familia "{}" no dibuja el parametro "{}" y hay que poner el '
                   'correcto en IN[3]. Ninguna API dice cual dibuja, asi que el graph no puede '
                   'detectarlo solo.'.format(familia_tag, param_dibuja or param_lee))

    TransactionManager.Instance.ForceCloseTransaction()

OUT = log
# ----------------------------------------
log = Watch(python_script)  # graph output
